% Simulink data dictionary nuwc_example_data_dictionary.sldd

input_signal = Simulink.Signal(StorageClass="ExportToFile", HeaderFile="interface_data.h", DataType="double")
output_signal = Simulink.Signal(StorageClass="ExportToFile", HeaderFile="interface_data.h", DataType="double")
old_parameter = Simulink.Parameter(42, StorageClass="ExportToFile", HeaderFile="interface_data.h", DataType="double")
new_parameter = Simulink.Parameter(42, StorageClass="ExportToFile", HeaderFile="interface_data.h", DataType="double")
SharedConfigurationSet = Simulink.ConfigSet(StartTime="0", StopTime="inf", FixedStep="1", Solver="FixedStepDiscrete", ProdHWDeviceType="Intel->x86-64 (Windows64)", SystemTargetFile="ert.tlc", TargetLang="C")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